# Dynamo graph old_script.dyn "script" (Dynamo 2.12.1.8246)
# packages: archi-lab.net 2023.213.1722

# group: Electrical parameters
parameter_types = ParameterTypeUi("YesNo")
current = Document.Current()
byDocument = FamilyDocument.ByDocument(document=current)
code_block = CodeBlock()
# ---------- code_block.designscript (11 lines) ----------
"Number of Poles";
"Load Classification";
"Voltage";
"Apparent Load";
"Power Factor";

// Por ahora no se agregará el parametro
"Load Sub-Classification Motor";
// No es posible asignar el parametro a false
// debido a un Issue 437 GitHub
// https://github.com/DynamoDS/DynamoRevit/issues/2821
# ----------------------------------------
list_create = List.Create(item0=code_block.out0, item1=code_block.out1, item2=code_block.out2, item3=code_block.out3, item4=code_block.out4)
parameter_groups = ParameterGroupUi("PG_ELECTRICAL")
parameter_types_2 = ParameterTypeUi("NumberOfPoles")
parameter_types_3 = ParameterTypeUi("LoadClassification")
parameter_types_4 = ParameterTypeUi("ElectricalPotential")
parameter_types_5 = ParameterTypeUi("ElectricalApparentPower")
parameter_types_6 = ParameterTypeUi("Number")
list_create_2 = List.Create(item0=parameter_types_2, item1=parameter_types_3, item2=parameter_types_4, item3=parameter_types_5, item4=parameter_types_6)
code_block_2 = CodeBlock { false; }
addParameter = FamilyDocument.AddParameter(familyDocument=byDocument, parameterName=list_create, parameterGroup=parameter_groups, parameterType=list_create_2, isInstance=code_block_2)

code_block_3 = CodeBlock { null; }
ne = addParameter != code_block_3
code_block_4 = CodeBlock { "Successful operation¡"; "Operation fail¡"; }
if_ = RefactoredIf(test=ne, true=code_block_4.out0, false=code_block_4.out1, lacing=Shortest)
watch = Watch(if_)  # graph output
code_block_5 = CodeBlock(x=if_) { x[0]; }
python_script_create_task_dialog = Python(IN[0]=code_block_5)  # IronPython2
# ---------- python_script_create_task_dialog.python (11 lines) ----------
# Load the Python Standard and DesignScript Libraries
import sys
import clr
clr.AddReference('RevitAPIUI')
from Autodesk.Revit.UI import TaskDialog

# The inputs to this node will be stored as a list in the IN variables.
msg = IN[0]

msgBox = TaskDialog
OUT = msgBox.Show("Parameters", msg)
# ----------------------------------------
