# Dynamo graph dynamo_caida de tension.dyn (Dynamo 2.6.1.8786)
# packages: archi-lab.net 2023.213.1722

code_block = CodeBlock { 469428; }
byElementId = archilab.Revit.Selection.Select.ByElementId(id=code_block)

# group: Obtener todos los circuitos del proyecto
categories = Categories("OST_ElectricalCircuit")  # frozen
all_elements_of_category = ElementsOfCategory(Category=categories)
string = StringInput("Load Name")
getParameterValueByName = Element.GetParameterValueByName(element=byElementId, parameterName=string)

code_block_2 = CodeBlock()
# ---------- code_block_2.designscript (5 lines) ----------
/*NOMBRE DEL PARÁMETRO TÍPO NÚMERO
DONDE SE ESCRIBIRÁN LOS RESULTADOS DE CAIDA DE TENSIÓN*/


"VLR_CAIDA DE TENSIÓN";
# ----------------------------------------

# group: Parámetros del modelo BIM
code_block_3 = CodeBlock(t1=byElementId)
# ---------- code_block_3.designscript (20 lines) ----------
//Obetención de variables para calcular

//Parámetros Nativos de Revit
p1 = Elements.Element.GetParameterValueByName(t1, "Length");
p2 = Elements.Element.GetParameterValueByName(t1, "True Current");
p3 = Elements.Element.GetParameterValueByName(t1, "Voltage");
p4 = Elements.Element.GetParameterValueByName(t1, "Number of Poles");
p5 = Elements.Element.GetParameterValueByName(t1, "Power Factor");
p6 = Elements.Element.GetParameterValueByName(t1, "Demmand Factor");
p7 = Elements.Element.GetParameterValueByName(t1, "True Load");



//Parámetros Compartidos
pc1 = Elements.Element.GetParameterValueByName(t1, "Tamaño del Conductor");
/*Convertir de número a texto el calibre AWG
para consultas en diccionarios*/
conductor_AWG(pc1);

pc2 = Elements.Element.GetParameterValueByName(t1, "VLR_CONDUCTORES POR FASE");
# ----------------------------------------

# group: Corriente Nominal
code_block_4 = CodeBlock(Fases=code_block_3.p4, Carga_instalada=code_block_3.p7, Voltage=code_block_3.p3)
# ---------- code_block_4.designscript (19 lines) ----------
//Cálculo de corriente nominal
//Definir las variables

//Número de fases
a = Fases;

//Carga instalada del circuito
b = Carga_instalada;

//Voltage del sistema
c = Voltage;

// Fórmula para cálculo de corriente nóminal
// dependiendo del numero de fases
Corriente_Nominal = (a == 1) ? b / (c * 0.9) :
            (a == 2) ? b / (2 * c * 0.9) :
            (a == 3) ? b / ((Math.Sqrt(3)) * c * 0.9) :
            "Error";
  // O un valor predeterminado si D no es 1, 2, o 3
# ----------------------------------------

# group: Caida de tensión
code_block_5 = CodeBlock(longitud_del_circuito=code_block_3.p1, corriente_nominal=code_block_4.Corriente_Nominal, voltaje=code_block_3.p3, secc_cond=code_block_3.pc1)  # unwired: polos
# ---------- code_block_5.designscript (23 lines) ----------
//Cálculo de caida de tensión
//Método Sección Transversal
//Variables

//longitud del circuito
a=longitud_del_circuito;
 //Corriente nominal;
b=corriente_nominal;
 //Tensión del sistema;
d=voltaje;
//sección transversal del conductor
e= seccion_del_conductor(secc_cond);

//Fórmulas de caida de tensión
caida_tension1=(4*a*b)/(d*e);
caida_tension2=(2*a*b)/(d*e);
caida_tension3=(2*Math.Sqrt(3)*a*b)/(d*e);

//Cálculo de la caida de tensión
caida_tension = (polos == 1) ? caida_tension1 :
				(polos == 2) ? caida_tension2 :
				(polos == 3) ? caida_tension3 :
				"Valor no válido";
# ----------------------------------------

code_block_6 = CodeBlock { 0; }
replaceNull = archilab.Lists.Lists.ReplaceNull(list=code_block_5.caida_tension, replacement=code_block_6)  # frozen
code_block_7 = CodeBlock { 2; }
round = Math.Round(number=replaceNull, digits=code_block_7)
setParameterByName = Element.SetParameterByName(element=byElementId, parameterName=code_block_2, value=round)

# group: Funciones
code_block_8 = CodeBlock()
# ---------- code_block_8.designscript (28 lines) ----------
/*Cálculo de caida de tensión por el método
de sección transversal
Variables
a = longitud del circuito
b = corriente nominal
c = voltage
d = sección del conductor
e = número de fases (polos)
*/

def e_seccion_transversal(a,b,c,d,e)

{

//Fórmulas de caida de tensión
caida_tension1=(4*a*b)/(c*d);
caida_tension2=(2*a*b)/(c*d);
caida_tension3=(2*Math.Sqrt(3)*a*b)/(c*d);

//Cálculo de la caida de tensión
e_tension = (e == 1) ? caida_tension1 :
				(e == 2) ? caida_tension2 :
				(e == 3) ? caida_tension3 :
				"Valor no válido";

return e_tension;

};
# ----------------------------------------
code_block_9 = CodeBlock()
# ---------- code_block_9.designscript (15 lines) ----------
/*Cálculo de corriente nominal
Definir las variables
a =Número de fases
b = Carga instalada del circuito
c = Voltage del sistema
*/

def corriente_Nominal(a,b,c)
{
cn = (a == 1) ? b / (c * 0.9) :
            (a == 2) ? b / (2 * c * 0.9) :
            (a == 3) ? b / ((Math.Sqrt(3)) * c * 0.9) :
            "Error";
return cn;
};
# ----------------------------------------
code_block_10 = CodeBlock()
# ---------- code_block_10.designscript (31 lines) ----------
/*Convertir un calibre AWG de número a texto
La operación se hace con If incrustado ya que Dynamo
no permite el uso de números para las llaves en un
diccionario*/

def conductor_AWG(CONDUCTOR_DECIMAL)
{
resultado = (CONDUCTOR_DECIMAL == 14) ? "14" :
            (CONDUCTOR_DECIMAL == 12) ? "12" :
            (CONDUCTOR_DECIMAL == 10) ? "10" :
            (CONDUCTOR_DECIMAL == 8) ? "8" :
            (CONDUCTOR_DECIMAL == 6) ? "6" :
            (CONDUCTOR_DECIMAL == 4) ? "4" :
            (CONDUCTOR_DECIMAL == 2) ? "2" :
            (CONDUCTOR_DECIMAL == 0.01) ? "1/0" :
            (CONDUCTOR_DECIMAL == 0.002) ? "2/0" :
            (CONDUCTOR_DECIMAL == 0.0003) ? "3/0" :
            (CONDUCTOR_DECIMAL == 0.00004) ? "4/0" :
            (CONDUCTOR_DECIMAL == 250) ? "250" :
            (CONDUCTOR_DECIMAL == 300) ? "300" :
            (CONDUCTOR_DECIMAL == 350) ? "350" :
            (CONDUCTOR_DECIMAL == 400) ? "400" :
            (CONDUCTOR_DECIMAL == 500) ? "500" :
            (CONDUCTOR_DECIMAL == 600) ? "600" :
            (CONDUCTOR_DECIMAL == 750) ? "750" :
            (CONDUCTOR_DECIMAL == 1000) ? "1000" :
            "0";

return resultado;

};
# ----------------------------------------
code_block_11 = CodeBlock()
# ---------- code_block_11.designscript (31 lines) ----------
//Sección transversal de conductores

def seccion_del_conductor(st1 : string)
{

dict1 = {
    "14": 2.08,
    "12": 3.31,
    "10": 5.26,
    "8": 8.37,
    "6": 13.3,
    "4": 21.2,
    "2": 33.6,
    "1/0": 53.49,
    "2/0": 67.43,
    "3/0": 85.01,
    "4/0": 107.2,
    "250": 127,
    "300": 152,
    "350": 177,
    "400": 203,
    "500": 253,
    "600": 304,
    "750": 380,
    "1000": 507
};
seccion = Dictionary.ValueAtKey(dict1,st1);

return seccion;

};
# ----------------------------------------
code_block_12 = CodeBlock()  # unwired: long, corriente_nominal, voltage, secc_cond, Polos
# ---------- code_block_12.designscript (23 lines) ----------
//Cálculo de caida de tensión
//Método por Impedancia
//Variables

//longitud del circuito conversión a KM
a=long/1000;
 //Corriente nominal;
b=corriente_nominal;
 //Tensión del sistema;
d=voltage;
//sección transversal del conductor
e= secc_cond;

//Fórmulas de caida de tensión
caida_tension1=(4*a*b)/(d*e);
caida_tension2=(2*a*b)/(d*e);
caida_tension3=(2*Math.Sqrt(3)*a*b)/(d*e);

//Cálculo de la caida de tensión
caida_tension = (Polos == 1) ? caida_tension1 :
				(Polos == 2) ? caida_tension2 :
				(Polos == 3) ? caida_tension3 :
				"Valor no válido";
# ----------------------------------------

watch = Watch(code_block_4.Corriente_Nominal)
watch_2 = Watch(code_block_5.e)
watch_3 = Watch(code_block_3.pc1)
