# Dynamo graph script.dyn "Get and set middle elevation for conduit" (Dynamo 2.12.1.8246)

select_model_elements = DSModelElementsSelection()  # 1 picked in the model; graph input
code_block = CodeBlock { "Middle Elevation"; }
select_model_element = DSModelElementSelection()  # 1 picked in the model; graph input
getParameterValueByName = Element.GetParameterValueByName(element=select_model_element, parameterName=code_block)
setParameterByName = Element.SetParameterByName(element=select_model_elements, parameterName=code_block, value=getParameterValueByName)
