# Dynamo graph script.dyn (Dynamo 2.12.1.8246)

element_types = ElementTypes("Pipe")
all_elements_of_type = ElementsOfType(element_type=element_types)
code_block = CodeBlock { "System Classification"; }
getParameterValueByName = Element.GetParameterValueByName(element=all_elements_of_type, parameterName=code_block)
code_block_2 = CodeBlock { "Sanitary"; }
eq = getParameterValueByName == code_block_2
filterByBoolMask = List.FilterByBoolMask(list=all_elements_of_type, mask=eq)
code_block_3 = CodeBlock { "VLR_GASTO SANITARIO"; }
file_path = Filename(".\Unidades Mueble.xlsx")
file_from_path = FileObject(path=file_path)
code_block_4 = CodeBlock { "Hoja1"; }
code_block_5 = CodeBlock { false; }
importExcel = Data.ImportExcel(file=file_from_path, sheetName=code_block_4, showExcel=code_block_5)
transpose = List.Transpose(lists=importExcel)
code_block_6 = CodeBlock(list=transpose) { list[0]; list[1]; }
string_from_object = FromObject(object=code_block_6.out0)
code_block_7 = CodeBlock { "."; }
split = String.Split(string=string_from_object, separator0=code_block_7)
code_block_8 = CodeBlock { 0; }
getItemAtIndex = List.GetItemAtIndex(list=split@L2, index=code_block_8)
byKeysValues = DesignScript.Builtin.Dictionary.ByKeysValues(keys=getItemAtIndex, values=code_block_6.out1)
code_block_9 = CodeBlock { "Fixture Units"; }
getParameterValueByName_2 = Element.GetParameterValueByName(element=filterByBoolMask.in, parameterName=code_block_9)
string_from_object_2 = FromObject(object=getParameterValueByName_2)
code_block_10 = CodeBlock { "."; }
split_2 = String.Split(string=string_from_object_2, separator0=code_block_10)
code_block_11 = CodeBlock { 0; }
getItemAtIndex_2 = List.GetItemAtIndex(list=split_2@L2, index=code_block_11)
valueAtKey = DesignScript.Builtin.Dictionary.ValueAtKey(dictionary=byKeysValues, key=getItemAtIndex_2)
setParameterByName = Element.SetParameterByName(element=filterByBoolMask.in, parameterName=code_block_3, value=valueAtKey)
