# Dynamo graph Get duct fittings metal sheet area.dyn (Dynamo 2.13.1.3887)

select_model_elements = DSModelElementsSelection()  # 5 picked in the model
python_script = Python(IN[0]=select_model_elements)  # IronPython2
# ---------- python_script.python (52 lines) ----------
import clr
clr.AddReference('RevitAPI')
from Autodesk.Revit.DB import *
clr.AddReference('RevitServices')
import RevitServices
from RevitServices.Persistence import DocumentManager
from RevitServices.Transactions import TransactionManager

# Get the current document
doc = DocumentManager.Instance.CurrentDBDocument

# Input duct fitting(s) from Dynamo
input_fittings = UnwrapElement(IN[0])

# Ensure input_fittings is a list
if not isinstance(input_fittings, list):
    input_fittings = [input_fittings]

# Initialize lists to store the widths, heights, and diameters
widths = []
heights = []
diameters = []

# Iterate over each fitting
for fitting in input_fittings:
    mechanical_fitting = fitting.MEPModel
    connectors = mechanical_fitting.ConnectorManager.Connectors
    
    # Iterate over each connector to determine its shape and properties
    for connector in connectors:
        # Check if the connector is rectangular/oval or round
        if connector.Shape == ConnectorProfileType.Rectangular or connector.Shape == ConnectorProfileType.Oval:
            height = connector.Height if hasattr(connector, 'Height') else 0
            width = connector.Width if hasattr(connector, 'Width') else 0
            diameter = 0  # Rectangular/oval connectors do not have a diameter
        elif connector.Shape == ConnectorProfileType.Round:
            height = 0  # Round connectors do not have a height
            width = 0  # Round connectors do not have a width
            diameter = connector.Radius * 2 if hasattr(connector, 'Radius') else 0  # Diameter is twice the radius
        else:
            # In case of an unknown shape, set all values to 0
            height = 0
            width = 0
            diameter = 0

        # Append the values to the respective lists
        heights.append(height)
        widths.append(width)
        diameters.append(diameter)

# Output the lists of widths, heights, and diameters
OUT = [widths, heights, diameters]
# ----------------------------------------
convert_by_units = DynamoUnitConvert(python_script, MeasurementType="autodesk.unit.quantity:length-1.0.4", FromConversion="autodesk.unit.unit:feet-1.0.1", ToConversion="autodesk.unit.unit:meters-1.0.0")
solids = Element.Solids(element=select_model_elements)
area = Solid.Area(solid=solids)
faces = Topology.Faces(topology=solids)
surfaceGeometry = Face.SurfaceGeometry(face=faces)
area_2 = Surface.Area(surface=surfaceGeometry)
sum = Math.Sum(values=area_2)
code_block = CodeBlock(list1=solids) { list1[0]; }
watch_3d = Watch3D(code_block)
code_block_2 = CodeBlock(list1=solids) { list1[1]; }
watch_3d_2 = Watch3D(code_block_2)
code_block_3 = CodeBlock(list1=solids) { list1[2]; }
watch_3d_3 = Watch3D(code_block_3)
